# Dynamo custom node CollectViewFamilyTypes.dyf "© Collect.ViewTypes" (Dynamo 2.12.1.8246)
# category: Crumple.Revit.Query
# Returns all view family type objects and names.

Refresh = Input(Refresh: bool = true)  # Toggle to refresh
python_script = Python(IN[0]=Refresh)  # IronPython2
# ---------- python_script.python (17 lines) ----------
# Made by Gavin Crump
# Free for use
# BIM Guru, www.bimguru.com.au

# Boilerplate text
import clr
import System

clr.AddReference("RevitAPI")
import Autodesk 
from Autodesk.Revit.DB import ViewFamily

# Enumerate over all BIPG types
pgnms = [(a, a.ToString()) for a in System.Enum.GetValues(ViewFamily)]

# Preparing output to Dynamo
OUT = zip(*pgnms)
# ----------------------------------------
code_block = CodeBlock(lst=python_script) { pg = lst[0]; nm = lst[1]; }
names = Output(code_block.nm)  # The names.
viewFamilyTypes = Output(code_block.pg)  # The types.
