# Dynamo custom node DateTimeFormatted.dyf (Dynamo 2.3.0.5885)
# category: Crumple.Input.DateTime
# A typical date time format for the current time, as well as date prefix and time suffix fields. These are typically useful for appending to file names generated via Dynamo.

Refresh = Input(Refresh: bool = true)
python_script = Python(IN[0]=Refresh)
# ---------- python_script.python (14 lines) ----------
# Made by Gavin Crump
# Free for use
# BIM Guru, www.bimguru.com.au

#Import the datetime package, define alias to avoid confusion
import datetime as dt

#Obtain the formatted datetimes
dt_c = dt.datetime.now().strftime("%d/%m/%y %H:%M:%S")
dt_d = dt.datetime.now().strftime("%y%m%d")
dt_t = dt.datetime.now().strftime("%H%M%S")

#Output list
OUT = [dt_c, dt_d, dt_t]
# ----------------------------------------
code_block = CodeBlock(dt=python_script) { dt[0]; dt[1]; dt[2]; }
Full = Output(code_block.out0)
DatePrefix = Output(code_block.out1)
TimeSuffix = Output(code_block.out2)
