# Dynamo custom node DesignOptionsOptionSet.dyf "© DesignOptions.OptionSet" (Dynamo 2.3.0.5885)
# category: Crumple.Revit.Query
# For a given design option, return its related set.

designOption = Input(designOption: var[]..[])
python_script = Python(IN[0]=designOption)
# ---------- python_script.python (32 lines) ----------
# Made by Gavin Crump
# Free for use
# BIM Guru, www.bimguru.com.au

# Boilerplate text
import clr

clr.AddReference('RevitAPI')
import Autodesk 
from Autodesk.Revit.DB import *

clr.AddReference("RevitNodes")
import Revit
clr.ImportExtensions(Revit.Elements)

# Define option set function
def GetDesignOptionSet(item):
	try: return item.Document.GetElement(item.get_Parameter(BuiltInParameter.OPTION_SET_ID).AsElementId()).ToDSType(True)
	except: return None

# Collect and unwrap options
options = IN[0] if isinstance(IN[0], list) else [IN[0]]
options_uw = UnwrapElement(options)

sets = []

# Get option sets
for o in options_uw:
	sets.append(GetDesignOptionSet(o))

# Preparing output to Dynamo
OUT = sets
# ----------------------------------------
optionSet = Output(python_script)
