# Dynamo custom node ElementsDelete.dyf "© Elements.Delete" (Dynamo 2.12.1.8246)
# category: Crumple.Revit.Create
# Given a list of elements, attempt to delete them and then return true or false depending on whether it could be deleted. This script flattens the list structure before attempting.

elements = Input(elements: var[]..[])
python_script = Python(IN[0]=elements)  # IronPython2
# ---------- python_script.python (44 lines) ----------
# Made by Gavin Crump
# Free for use
# BIM Guru, www.bimguru.com.au

# Boilerplate text
import clr

clr.AddReference("RevitServices")
import RevitServices
from RevitServices.Persistence import DocumentManager
from RevitServices.Transactions import TransactionManager

doc = DocumentManager.Instance.CurrentDBDocument

# Define list/unwrap list functions
def uwlist(input):
    result = input if isinstance(input, list) else [input]
    return UnwrapElement(result)

def objOrList(input, initial = IN[0]):
	if isinstance(initial, list):
		return input
	else:
		return input[0]

#unwrap all elements to use with API
elements = uwlist(IN[0])

# Check and delete
TransactionManager.Instance.EnsureInTransaction(doc)

results = []

for e in elements:
	try:
		doc.Delete(e.Id)
		results.append(True)
	except:
		results.append(False)

TransactionManager.Instance.TransactionTaskDone()
   
# Result of transaction
OUT = objOrList(results)
# ----------------------------------------
wasDeleted = Output(python_script)
