# Dynamo custom node FamilyDocTitle.dyf "© FamilyDoc.Title" (Dynamo 2.12.1.8246)
# category: Crumple.Revit.Query
# Returns the title of a family document in the unwrapped state. Can be used in conjunction with nodes like 'FamilyDocOpen'.

familyDocs = Input(familyDocs: var[]..[])  # A family document or list of family documents.
python_script = Python(IN[0]=familyDocs)  # IronPython2
# ---------- python_script.python (23 lines) ----------
# Made by Gavin Crump
# Free for use
# BIM Guru, www.bimguru.com.au

# Boilerplate text
import clr

# Define list/unwrap list functions
def tolist(input):
    result = input if isinstance(input, list) else [input]
    return result

def objOrList(input, initial = IN[0]):
	if isinstance(initial, list):
		return input
	else:
		return input[0]

# Current doc/app/ui
docs = tolist(IN[0])

# Preparing output to Dynamo
OUT = objOrList([d.Title for d in docs])
# ----------------------------------------
titles = Output(python_script)
