# Dynamo custom node FamilyEditDocument.dyf "© Family.EditDocument" (Dynamo 2.16.2.5624)
# category: Crumple.Revit.Actions
# Attempts to edit (open) a copy of a family in the project as a background document.

families = Input(families: var[]..[])
python_script = Python(IN[0]=families)  # CPython3
# ---------- python_script.python (44 lines) ----------
# Made by Gavin Crump
# Free for use
# BIM Guru, www.bimguru.com.au

# Boilerplate text
import clr

clr.AddReference("RevitServices")
import RevitServices
from RevitServices.Transactions import TransactionManager

# Define list/unwrap list functions
def uwlist(input):
    result = input if isinstance(input, list) else [input]
    return UnwrapElement(result)

# Function to activate family
def activateFamily(fam):
	TransactionManager.Instance.EnsureInTransaction(fam.Document)
	famSymbolIds = fam.GetFamilySymbolIds()
	for i in famSymbolIds:
		fs = fam.Document.GetElement(i)
		fs.Activate()
	TransactionManager.Instance.TransactionTaskDone()
	TransactionManager.Instance.ForceCloseTransaction()
	return None

# Preparing input from dynamo to revit
families = uwlist(IN[0])
famDocs, results = [],[]

# Edit families
for f in families:
	activateFamily(f, f.Document)
	try:
		famDoc = f.Document.EditFamily(f)
		famDocs.append(famDoc)
		results.append(True)
	except:
		famDocs.append(None)
		results.append(False)

# Preparing output to Dynamo
OUT = famDocs, results
# ----------------------------------------
code_block = CodeBlock(out=python_script) { out[0]; out[1]; }
familyDocs = Output(code_block.out0)
wasEdited = Output(code_block.out1)
