# Dynamo custom node FamilyParamIsInstance.dyf "© FamilyParam.IsInstance" (Dynamo 2.12.1.8246)
# category: Crumple.Revit.Query
# For a family parameter or list of them, return if the parameters are instance based.

familyParams = Input(familyParams: var[]..[])  # Lists of family parameters.
python_script_get_data = Python(IN[0]=familyParams)  # IronPython2
# ---------- python_script_get_data.python (21 lines) ----------
# Made by Gavin Crump
# Free for use
# BIM Guru, www.bimguru.com.au

# Boilerplate text
import clr

clr.AddReference('RevitAPI')
import Autodesk 
from Autodesk.Revit.DB import Parameter

# Define list/unwrap list functions
def tolist(input):
    result = input if isinstance(input, list) else [input]
    return result

#Inputdoc
params_list = tolist(IN[0])

# Output the lists
OUT = [param.IsInstance for param in params_list]
# ----------------------------------------
Parameter_is_instance_based_isInstance = Output(python_script_get_data)  # "/*Parameter is instance based.*/ isInstance"
