# Dynamo custom node FamilyParamIsShared.dyf "© FamilyParam.IsShared" (Dynamo 2.12.1.8246)
# category: Crumple.Revit.Query
# For a family parameter or list of them, return if the parameters are shared.

familyParams = Input(familyParams: var[]..[])  # Lists of family parameters.
python_script_get_data = Python(IN[0]=familyParams)  # IronPython2
# ---------- python_script_get_data.python (21 lines) ----------
# Made by Gavin Crump
# Free for use
# BIM Guru, www.bimguru.com.au

# Boilerplate text
import clr

clr.AddReference('RevitAPI')
import Autodesk 
from Autodesk.Revit.DB import Parameter

# Define list/unwrap list functions
def tolist(input):
    result = input if isinstance(input, list) else [input]
    return result

#Inputdoc
params_list = tolist(IN[0])

# Output the lists
OUT = [param.IsShared for param in params_list]
# ----------------------------------------
Parameter_is_shared_isShared = Output(python_script_get_data)  # "/*Parameter is shared.*/ isShared"
