# Dynamo custom node FamilySaveAs.dyf "© Family.SaveAs" (Dynamo 2.12.1.8246)
# category: Crumple.Revit.Create
# Saves families in the current document to the given file paths.

families = Input(families: var[]..[])
filePaths = Input(filePaths: var[]..[])
python_script = Python(IN[0]=families, IN[1]=filePaths)  # IronPython2
# ---------- python_script.python (50 lines) ----------
# Made by Gavin Crump
# Free for use
# BIM Guru, www.bimguru.com.au

# Boilerplate text
import clr

clr.AddReference("RevitAPI")
import Autodesk 
from Autodesk.Revit.DB import *

clr.AddReference("RevitServices")
import RevitServices
from RevitServices.Persistence import DocumentManager 

# Define list/unwrap list functions
def tolist(input):
    result = input if isinstance(input, list) else [input]
    return result

def uwlist(input):
    result = input if isinstance(input, list) else [input]
    return UnwrapElement(result)

# Current doc/app/ui
doc = DocumentManager.Instance.CurrentDBDocument

# Preparing input from dynamo to revit
families = uwlist(IN[0])
filePaths = tolist(IN[1])

outcomes = []

# Make save options
options = SaveAsOptions()
options.OverwriteExistingFile = True

# For each family and file path...
for fam,fp in zip(families,filePaths):
	# Try to open save and close
	try:
		famDoc = doc.EditFamily(fam)
		famDoc.SaveAs(fp, options)
		famDoc.Close(False)
		outcomes.append(True)
	except:
		outcomes.append(False)

# Preparing output to Dynamo
OUT = outcomes
# ----------------------------------------
wasSaved = Output(python_script)
