# Dynamo custom node GroupHasExclusions.dyf "© Group.HasExclusions" (Dynamo 2.16.2.5624)
# category: Crumple.Revit.Query
# Returns a boolean as to whether a group contains excluded elements.

group = Input(group: var[]..[])
python_script = Python(IN[0]=group)  # CPython3
# ---------- python_script.python (27 lines) ----------
# Boilerplate text
import clr

def uwlist(input):
    result = input if isinstance(input, list) else [input]
    return UnwrapElement(result)

def objOrList(input, initial = IN[0]):
	if isinstance(initial, list):
		return input
	else:
		return input[0]

# Preparing input from dynamo to revit
groups = uwlist(IN[0])

excluded = []

# Check for excluded elements
for group in groups:
	if "excluded" in group.Name:
		excluded.append(True)
	else:
		excluded.append(False)

# Preparing output to Dynamo
OUT = objOrList(excluded)
# ----------------------------------------
hasExclusions = Output(python_script)
