# Dynamo custom node RevitCurrentView.dyf "© Revit.CurrentView" (Dynamo 2.16.2.5624)
# category: Crumple.Application.Query
# Given the current document, return the active view.

refresh = Input(refresh: bool = true)
code_block = CodeBlock(x=refresh) { x; document1 = Revit.Document.Current; Revit.Document.ActiveView(document1); }
view = Output(code_block.out2)
