# Dynamo custom node RevitImportCad.dyf "© Revit.ImportCAD" (Dynamo 2.3.1.11775)
# category: Crumple.Application.Actions
# Attempts to import CAD files from file paths to nominated views.

filePaths = Input(filePaths: var[]..[])
importView = Input(importView: var[]..[] = Revit.Application.Document.Current.ActiveView)  # As many Views as FilePaths
unitType = Input(unitType: string = "Meter")
python_script = Python(IN[0]=filePaths, IN[1]=importView, IN[2]=unitType)
# ---------- python_script.python (82 lines) ----------
# Made by Gavin Crump
# Free for use
# BIM Guru, www.bimguru.com.au

# Boilerplate text
import clr
import System

clr.AddReference('RevitServices')
import RevitServices
from RevitServices.Persistence import DocumentManager
from RevitServices.Transactions import TransactionManager

clr.AddReference('RevitAPI')
import Autodesk
from Autodesk.Revit.DB import *

doc = DocumentManager.Instance.CurrentDBDocument

# Define list/unwrap list functions
def tolist(input):
    result = input if isinstance(input, list) else [input]
    return result

def uwlist(input):
    result = input if isinstance(input, list) else [input]
    return UnwrapElement(result)

# Get inputs
filePaths = tolist(IN[0])
views = uwlist(IN[1])

# Get import unit types as enumeration
enums = System.Enum.GetValues(Autodesk.Revit.DB.ImportUnit)
names = [str(u) for u in enums]

# Find matching enum unit type
i = names.index(IN[2])
unitType = enums[i]

# CAD settings
customscale = False
colormode = "Preserve"
placement = "Origin"
allView = True

# Empty lists
viewsplaced,outName,CADlinktype,importinstance = [],[],[],[]

# Import options
options = DWGImportOptions()
options.AutoCorrectAlmostVHLines = True
options.OrientToView = False
options.ThisViewOnly = False
options.VisibleLayersOnly = True
ImportColorMode.Preserved
options.Placement.Origin
options.Unit = unitType

# Create ElementId / .NET object
linkedElem = clr.Reference[ElementId]()

# Import CAD files
for fp in filePaths:
	
	try:
		TransactionManager.Instance.EnsureInTransaction(doc)
		doc.Import(fp, options, views, linkedElem)
		TransactionManager.Instance.TransactionTaskDone()
	
		importinst = doc.GetElement(linkedElem.Value)
		importinstance.append(importinst)
		
		viewsplaced.append(True)
	
	except:
	
		importinstance.append(None)
		viewsplaced.append(False)
	
# Outputs
OUT = [importinstance,viewsplaced]
# ----------------------------------------
code_block = CodeBlock(x=python_script) { x[0]; x[1]; }
importInstances = Output(code_block.out0)
success = Output(code_block.out1)
