# Dynamo custom node SheetRevisions.dyf "© Sheet.Revisions" (Dynamo 2.16.2.5624)
# category: Crumple.Revit.Query
# Given a sheet, returns all revisions associated with that sheet as elements.

sheet = Input(sheet: var[]..[])
python_script = Python(IN[0]=sheet)  # CPython3
# ---------- python_script.python (30 lines) ----------
# Made by Gavin Crump
# Free for use
# BIM Guru, www.bimguru.com.au

# Boilerplate text
import clr

# Define list/unwrap list functions
def uwlist(input):
    result = input if isinstance(input, list) else [input]
    return UnwrapElement(result)

def objOrList(input, initial = IN[0]):
	if isinstance(initial, list):
		return input
	else:
		return input[0]

# Preparing input from dynamo to revit
sheet_list = uwlist(IN[0])
sheet_revs = []

# Get revisions per sheet
for s in sheet_list:
	ids = s.GetAllRevisionIds()
	revs = [s.Document.GetElement(r) for r in ids]
	sheet_revs.append(revs)

# Preparing output to Dynamo
OUT = objOrList(sheet_revs)
# ----------------------------------------
revisions = Output(python_script)
