# Dynamo custom node SheetsCreate.dyf "© Sheets.Create" (Dynamo 2.12.1.8246)
# category: Crumple.Revit.Create
# Creates Revit sheets based on a list of names, numbers and a single Titleblock type.

ttb_type = Input(ttb_type: Revit.Elements.FamilyType)  # Titleblock as a family type. Note this node only applies one type to all sheets currently.
names = Input(names: var[]..[])  # Sheet names (strings).
numbers = Input(numbers: var[]..[])  # Sheet numbers (strings).
asph = Input(asph: bool = false)  # Are they placeholders?
python_script = Python(IN[0]=ttb_type, IN[1]=names, IN[2]=numbers, IN[3]=asph)  # IronPython2
# ---------- python_script.python (73 lines) ----------
# Made by Gavin Crump
# Free for use
# BIM Guru, www.bimguru.com.au

# Boilerplate text
import clr

clr.AddReference("RevitNodes")
import Revit
clr.ImportExtensions(Revit.Elements)

clr.AddReference("RevitServices")
import RevitServices
from RevitServices.Persistence import DocumentManager 
from RevitServices.Transactions import TransactionManager 

clr.AddReference("RevitAPI")
import Autodesk 
from Autodesk.Revit.DB import FilteredElementCollector, BuiltInCategory, ViewSheet

# Current doc/app/ui
doc = DocumentManager.Instance.CurrentDBDocument

# Define list/unwrap list functions
def tolist(input):
    result = input if isinstance(input, list) else [input]
    return result

def objOrList(input, initial = IN[1]):
	if isinstance(initial, list):
		return input
	else:
		return input[0]

# Collect all sheets
sheets = FilteredElementCollector(doc).OfCategory(BuiltInCategory.OST_Sheets).WhereElementIsNotElementType().ToElements()

sheetnos = [s.SheetNumber for s in sheets]

# Preparing input from dynamo to revit
ttb_d = IN[0]
names = tolist(IN[1])
numbers = tolist(IN[2])
asph = IN[3]

numexists = [n in sheetnos for n in numbers]

sheets,success = [],[]

# Unwrapping titleblock
ttb_r = UnwrapElement(ttb_d).Id

# Do some action in a Transaction
TransactionManager.Instance.EnsureInTransaction(doc)

for nam,num,nex in zip(names,numbers,numexists):
	if nex == False:
		if asph == True:
			placeholder = ViewSheet.CreatePlaceholder(doc)
		else:
			placeholder = ViewSheet.Create(doc,ttb_r)
		placeholder.SheetNumber = num
		placeholder.Name = nam
		sheets.append(placeholder.ToDSType(False))
		success.append(True)
	else:
		sheets.append(None)
		success.append(False)

TransactionManager.Instance.TransactionTaskDone()

# Preparing output to Dynamo
OUT = objOrList(sheets), objOrList(success)
# ----------------------------------------
code_block = CodeBlock(x=python_script) { shts = x[0]; erep = x[1]; }
sheets = Output(code_block.shts)  # Sheets created.
success = Output(code_block.erep)  # Was the process successful.
