# Dynamo custom node SheetsNameFormatted.dyf "© Sheets.NameFormatted" (Dynamo 2.3.0.5885)
# category: Crumple.Revit.Actions
# Given a list of sheets, apply a typical naming convention to them with some optional fields such as prefix and separator.

sheets = Input(sheets: var[]..[])
prefx = Input(prefx: string = "")
separator = Input(separator: string = " - ")
code_block = CodeBlock(s=sheets, prf=prefx, sep=separator)
# ---------- code_block.designscript (10 lines) ----------
s;
sht_name = Elements.Views.Sheet.SheetName(s);
sht_numb = Elements.Views.Sheet.SheetNumber(s);

sht_revs = Revit.Elements.Element.GetParameterValueByName(s, "Current Revision");
new_revs = " [" + sht_revs + "]";
fix_revs = DSCore.String.Replace(new_revs, " []", " [-]");

prf + sht_name + sep + sht_numb + fix_revs;
prf + sht_name + sep + sht_numb;
# ----------------------------------------
sheets_2 = Output(code_block.s)  # "sheets"
includeRevison = Input(includeRevison: bool = true)
if_ = If(test=includeRevison, true=code_block.out6, false=code_block.out7)
sheetName = Output(if_)
