# Dynamo custom node UILogoPath.dyf "© UI.LogoPath" (Dynamo 2.16.2.5624)
# category: Crumple.Script.Query
# Returns the file path of your 'My Documents' folder, then the file 'logo.png'. If you store your logo here you can call on it reliably for Data Shapes interfaces.

refresh = Input(refresh: bool = True)
python_script = Python(IN[0]=refresh)  # CPython3
# ---------- python_script.python (11 lines) ----------
# Made by Gavin Crump
# Free for use
# BIM Guru, www.bimguru.com.au
# Thanks to Sean Page for suggesting the os package

# Boilerplate text
import clr
import os

fl = os.environ.get('USERPROFILE')
OUT = os.path.join(fl, 'Documents', 'logo.png')
# ----------------------------------------
path = Output(python_script)
