# Dynamo custom node WindowsMyDocuments.dyf "© Windows.MyDocuments" (Dynamo 2.16.2.5624)
# category: Crumple.Application.Query
# This node returns the active username, as well as a path to the user's My Documents.

refresh = Input(refresh: bool = true)  # Toggle to refresh
python_script = Python(IN[0]=refresh)  # CPython3
# ---------- python_script.python (11 lines) ----------
# Made by Gavin Crump
# Free for use
# BIM Guru, www.bimguru.com.au
# Thanks to Sean Page for suggesting the os package

# Boilerplate text
import clr
import os

userFolder = os.path.join(os.environ['USERPROFILE'])
OUT = os.path.join(userFolder, 'Documents')
# ----------------------------------------
directoryPath = Output(python_script)  # The active user's My Documents path
