# Dynamo custom node WindowsUserFolder.dyf "© Windows.UserFolder" (Dynamo 2.16.2.5624)
# category: Crumple.Application.Query
# This node return's the active username, as well as a path to their user folder.

refresh = Input(refresh: bool = true)  # Toggle to refresh
python_script = Python(IN[0]=refresh)  # CPython3
# ---------- python_script.python (10 lines) ----------
# Made by Gavin Crump
# Free for use
# BIM Guru, www.bimguru.com.au
# Thanks to Sean Page for suggesting the os package

# Boilerplate text
import clr
import os

OUT = os.environ.get('USERPROFILE')
# ----------------------------------------
directoryPath = Output(python_script)  # The active user's user folder
